# Grasshopper definition MinBoundBox3d.ghx (Grasshopper 1.0.7)

geometry = Geometry(<brep referenced from the Rhino model>)
epsilon = Slider(0.0001, range=0.0001..1)
stepvolume = Slider(3, range=2..20)
stepplanar = Slider(3, range=2..20)
stepdivider = Slider(3, range=2..10)
imaxiteration = Slider(10000, range=1..10000)
dodrawiterationboxes = BooleanToggle(False)
panel = Panel("C:\Users\gyula.karli\DEV\Grasshopper Python szkriptek\MinBoundBox3d.py")
path_mapper = PathMapper(geometry, source="{A}", target="{0}")
integer = Integer(stepdivider)
integer_2 = Integer(stepvolume)
integer_3 = Integer(stepplanar)
test = BooleanToggle(True)
file_path = FilePath(panel)
minimum_bounding_box = GhPythonScript(
    Code=file_path,
    IsTest=test,
    Selection=path_mapper,
    Epsilon=epsilon,
    IsBoundaryOpt=Toggle(False),
    IStepVolume=integer_2,
    IStepPlanar=integer_3,
    IStepDivider=integer,
    IMaxIteration=imaxiteration,
    DoDrawIterationBoxes=dodrawiterationboxes)  # -> Out, Result
panel_2 = Panel(geometry)
panel_3 = Panel(minimum_bounding_box.Out)
panel_4 = Panel(minimum_bounding_box.Result)
