# Grasshopper definition Zsaluzás.ghx (Grasshopper 1.0.7)
# plug-ins: Grasshopper-ARCHICAD Live Connection built for Rhinoceros 7

# ---- group: Input
a_legalsó_slab_aljzatbeton_e = BooleanToggle(True)
column = Column()
slab = Slab()
beam = Beam()
wall = Wall(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)
roof = Roof()

# ----
deconstruct_wall = DeconstructWall(
    Wall=wall,
    SurfaceType0_SurfaceType=(1, 0, 0),
    SurfaceType1_ParamName="Reference Side Surfaces",
    SurfaceType1_SurfaceType=(1, 0, 0),
    SurfaceType2_SurfaceType=(1, 0, 0),
    SurfaceType3_SurfaceType=(1, 0, 0),
    SurfaceType4_SurfaceType=(1, 0, 0),
    SurfaceType5_SurfaceType=(1, 0, 0),
    SurfaceType6_SurfaceType=(1, 0, 0),
    SurfaceType7_SurfaceType=(1, 0, 0),
    SurfaceType8_ParamName="Wall Opening Reference Side Surfaces",
    SurfaceType8_SurfaceType=(1, 0, 0),
    SurfaceType9_ParamName="Wall Opening Reference Opposite Side Surfaces",
    SurfaceType9_SurfaceType=(1, 0, 0),
    SurfaceType10_ParamName="Wall Opening Side Surfaces",
    SurfaceType10_SurfaceType=(1, 0, 0),
    SurfaceType11_ParamName="Wall Opening Replacement Surfaces",
    SurfaceType11_SurfaceType=(1, 0, 0))  # -> Curve, Brep, WallSettings, ReferenceSideSurfaces, WallOpeningSideSurfaces, WallOpeningReferenceSideSurfaces, WallOpeningReferenceOppositeSideSurfaces, WallOpeningReplacementSurfaces
deconstruct_beam = DeconstructBeam(
    Beam=beam,
    SurfaceType0_SurfaceType=(1, 0, 0),
    SurfaceType1_SurfaceType=(1, 0, 0),
    SurfaceType2_SurfaceType=(1, 0, 0),
    SurfaceType3_SurfaceType=(1, 0, 0),
    SurfaceType4_SurfaceType=(1, 0, 0),
    SurfaceType5_ParamName="Bottom Surfaces",
    SurfaceType5_SurfaceType=(1, 0, 0),
    SurfaceType6_SurfaceType=(1, 0, 0),
    SurfaceType7_SurfaceType=(1, 0, 0),
    SurfaceType8_SurfaceType=(1, 0, 0),
    SurfaceType9_SurfaceType=(1, 0, 0))  # -> Curve, Brep, BeamSettings, BottomSurfaces
deconstruct_slab = DeconstructSlab(
    Slab=slab,
    SurfaceType0_SurfaceType=(1, 0, 0),
    SurfaceType1_ParamName="Top Surfaces",
    SurfaceType1_SurfaceType=(1, 0, 0),
    SurfaceType2_SurfaceType=(1, 0, 0),
    SurfaceType3_SurfaceType=(1, 0, 0),
    SurfaceType4_SurfaceType=(1, 0, 0),
    SurfaceType5_SurfaceType=(1, 0, 0))  # -> Polygon, Brep, SlabSettings, TopSurfaces
check_validity = Button()
deconstruct_roof = DeconstructRoof(
    RoofSinglePlane=roof,
    SurfaceType0_SurfaceType=(1, 0, 0),
    SurfaceType1_SurfaceType=(1, 0, 0),
    SurfaceType2_SurfaceType=(1, 0, 0),
    SurfaceType3_SurfaceType=(1, 0, 0),
    SurfaceType4_SurfaceType=(1, 0, 0),
    SurfaceType5_SurfaceType=(1, 0, 0),
    SurfaceType6_SurfaceType=(1, 0, 0),
    SurfaceType7_ParamName="Eaves Surfaces",
    SurfaceType7_SurfaceType=(1, 0, 0),
    SurfaceType8_SurfaceType=(1, 0, 0),
    SurfaceType9_SurfaceType=(1, 0, 0),
    SurfaceType10_SurfaceType=(1, 0, 0),
    SurfaceType11_SurfaceType=(1, 0, 0),
    SurfaceType12_SurfaceType=(1, 0, 0),
    SurfaceType13_SurfaceType=(1, 0, 0),
    SurfaceType14_SurfaceType=(1, 0, 0),
    SurfaceType15_SurfaceType=(1, 0, 0),
    SurfaceType16_SurfaceType=(1, 0, 0),
    SurfaceType17_SurfaceType=(1, 0, 0))  # -> Polygon, Brep, RoofSettings, EavesSurfaces
deconstruct_column = DeconstructColumn(
    Column=column,
    SurfaceType0_SurfaceType=(1, 0, 0),
    SurfaceType1_SurfaceType=(1, 0, 0),
    SurfaceType2_ParamName="Bottom Surfaces",
    SurfaceType2_SurfaceType=(1, 0, 0),
    SurfaceType3_SurfaceType=(1, 0, 0),
    SurfaceType4_SurfaceType=(1, 0, 0),
    SurfaceType5_SurfaceType=(1, 0, 0),
    SurfaceType6_SurfaceType=(1, 0, 0),
    SurfaceType7_SurfaceType=(1, 0, 0),
    SurfaceType8_SurfaceType=(1, 0, 0))  # -> AnchorPoint, EndPoint, simplify(Brep), ColumnSettings, BottomSurfaces
extract_beam_settings = ExtractBeamSettings(BeamSettings=deconstruct_beam.BeamSettings)  # -> Structure, BuildingMaterial, Profile, Height, Width, AxisOffset, degrees(ProfileRotation), Layer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
extract_slab_settings = ExtractSlabSettings(SlabSettings=deconstruct_slab.SlabSettings)  # -> Structure, BuildingMaterial, Composite, Thickness, degrees(EdgeAngle), ReferencePlane, Layer, HomeStory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
extract_wall_settings = ExtractWallSettings(WallSettings=deconstruct_wall.WallSettings)  # -> Structure, BuildingMaterial, Composite, Profile, Height, Thickness, ThicknessTrapezoid, degrees(OutsideSlantAngle)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
negative = Negative(Value=extract_slab_settings.Thickness)
area = Area(Geometry=[deconstruct_wall.WallOpeningSideSurfaces, deconstruct_wall.WallOpeningReferenceSideSurfaces, deconstruct_wall.WallOpeningReferenceOppositeSideSurfaces])  # -> flatten(Area), Centroid
unit_z = UnitZ(Factor=negative)
unit_z_2 = UnitZ(Factor=extract_beam_settings.Height)
number = Number(area.Area)
mass_addition = MassAddition(Input=number)  # -> Result, PartialResults
# Beam
cleanup_breps = CleanupBreps(brep=deconstruct_beam.BottomSurfaces, extrusion_direction=unit_z_2)
# Wall
cleanup_breps_2 = CleanupBreps(brep=deconstruct_wall.ReferenceSideSurfaces, value=extract_wall_settings.Thickness)
# Column
brep = Brep(flatten(deconstruct_column.Brep))
# Roof
brep_2 = Brep(flatten(deconstruct_roof.Brep))
# Slab
cleanup_breps_3 = CleanupBreps(brep=deconstruct_slab.TopSurfaces, extrusion_direction=unit_z)
path_mapper = PathMapper(mass_addition.Result, source="{A}(i)", target="{5}(i)")
path_mapper_2 = PathMapper(brep_2, source="{A}(i)", target="{4}(i)")
path_mapper_3 = PathMapper(brep, source="{A}(i)", target="{3}(i)")
path_mapper_4 = PathMapper(cleanup_breps_3, source="{A}(i)", target="{0}(i)")
path_mapper_5 = PathMapper(cleanup_breps, source="{A}(i)", target="{1}(i)")
path_mapper_6 = PathMapper(cleanup_breps_2, source="{A}(i)", target="{2}(i)")

# ---- group: Remove inner surfaces
brep_3 = Brep([path_mapper_5, path_mapper_4, path_mapper_6, path_mapper_3, path_mapper_2])
solid_union = SolidUnion(Breps=flatten(brep_3))
deconstruct_brep = DeconstructBrep(Brep=brep_3)  # -> Faces, Edges, Vertices
deconstruct_brep_2 = DeconstructBrep(Brep=solid_union)  # -> flatten(Faces), Edges, Vertices
area_2 = Area(Geometry=deconstruct_brep_2.Faces)  # -> Area, Centroid
cluster = Cluster(list=deconstruct_brep.Faces, item=area_2.Centroid)
insert_items = InsertItems(List=deconstruct_brep.Faces, Item=area_2.Centroid, Indices=0, Wrap=True)
list_length = ListLength(List=area_2.Centroid)
split_list = SplitList(List=insert_items, Index=list_length)  # -> ListA, ListB
surface = Surface(graft(deconstruct_brep.Faces))
surface_2 = Surface(deconstruct_brep_2.Faces)
trim_tree = TrimTree(Tree=split_list.ListA, Depth=2)
surface_closest_point = SurfaceClosestPoint(Point=trim_tree, Surface=surface)  # -> Point, UVPoint, Distance
smaller_than = SmallerThan(FirstNumber=surface_closest_point.Distance, SecondNumber=0.1)  # -> SmallerThan, OrEqualTo
cull_pattern = CullPattern(List=surface_2, CullPattern=smaller_than.SmallerThan)
path_mapper_7 = PathMapper(cull_pattern, source="{A;B;C}(i)", target="{A;B}(C)")

# ---- group: Validate
data = Data(flatten(smaller_than.SmallerThan))
sort_list = SortList(Keys=data)  # -> Keys, ValuesValuesA
mass_addition_2 = MassAddition(Input=sort_list.Keys)  # -> Result, PartialResults
equality = Equality(FirstNumber=list_length, SecondNumber=mass_addition_2.Result)  # -> Equality, Inequality
boolean = Boolean(equality.Equality)
panel = Panel(boolean)
gate_not = GateNot(A=boolean)
integer = Integer(255)
multiplication = Multiplication(A=integer, B=boolean)
multiplication_2 = Multiplication(A=integer, B=gate_not)
average = Average(Input=area_2.Centroid)
bounding_box = BoundingBox(Content=flatten(brep_3), Plane=PlaneXY(0, 0, 0), UnionBox=True)  # -> Box, Box_2
colour_rgb = ColourRGB(Alpha=255, Red=multiplication_2, Green=multiplication, Blue=0)
deconstruct_box = DeconstructBox(Box=bounding_box.Box)  # -> Plane, X, Y, Z
deconstruct = Deconstruct(Point=average)  # -> XComponent, YComponent, ZComponent
number_2 = Number(deconstruct_box.Z)
multiplication_3 = Multiplication(A=number_2, B=1.5)
construct_point = ConstructPoint(XCoordinate=deconstruct.XComponent, YCoordinate=deconstruct.YComponent, ZCoordinate=multiplication_3)
construct_point_2 = ConstructPoint(XCoordinate=deconstruct.XComponent, YCoordinate=deconstruct.YComponent, ZCoordinate=multiplication_3)
multiplication_4 = Multiplication(A=check_validity, B=1200)
cloud_display = CloudDisplay(Points=[construct_point, construct_point_2], Colours=colour_rgb, Size=multiplication_4, SpriteType=0)

# ----
list_length_2 = ListLength(List=path_mapper_4)
brep_4 = Brep(path_mapper_7)
series = Series(Start=0, Step=1, Count=list_length_2)
concatenate = Concatenate(Fragment_A="{0;", Fragment_B=series, A="}")
trim_tree_2 = TrimTree(Tree=brep_4, Depth=1)
tree_branch = TreeBranch(Tree=brep_4, Path=concatenate, MaintainPaths=True)
cullnull = CullNulls(item=tree_branch)
bounding_box_2 = BoundingBox(Content=cullnull, Plane=PlaneXY(0, 0, 0), UnionBox=True)  # -> Box, Box_2
volume = Volume(Geometry=flatten(bounding_box_2.Box))  # -> Volume, Centroid
deconstruct_2 = Deconstruct(Point=volume.Centroid)  # -> XComponent, YComponent, ZComponent
sort_list_2 = SortList(Keys=deconstruct_2.ZComponent, ValuesValuesA=series)  # -> Keys, ValuesValuesA
firstslab = GhPythonScript(isSlab=a_legalsó_slab_aljzatbeton_e)  # -> a; inputs isSlab: Boolean
# ---------- firstslab: Python ----------
__author__ = "samu.karli"
__version__ = "2022.05.18"

import rhinoscriptsyntax as rs

a = 1 if isSlab else 0
# ---------- end firstslab ----------
split_list_2 = SplitList(List=sort_list_2.ValuesValuesA, Index=firstslab)  # -> ListA, ListB

# ---- group: Slab / 1st slab
concatenate_2 = Concatenate(Fragment_A="{0;", Fragment_B=split_list_2.ListA, A="}")
tree_branch_2 = TreeBranch(Tree=brep_4, Path=concatenate_2, MaintainPaths=True)

# ---- group: Slab / upper slabs
concatenate_3 = Concatenate(Fragment_A="{0;", Fragment_B=split_list_2.ListB, A="}")
tree_branch_3 = TreeBranch(Tree=brep_4, Path=concatenate_3, MaintainPaths=True)

# ----
panel_2 = Panel("C:\Users\gyula.karli\DEV\Grasshopper Python szkriptek\Remove Surfaces.py")
test_remove_bottom_surfaces = BooleanToggle(False)
top_surfaces_to_remove = BooleanToggle(False)
tree_branch_4 = TreeBranch(Tree=trim_tree_2, Path="{4}", MaintainPaths=True)
split_tree = SplitTree(Data=path_mapper_7, Masks=flatten("{1; ?}"))  # -> Positive, Negative
split_tree_2 = SplitTree(Data=path_mapper_7, Masks=flatten("{2, 3; (?)}"))  # -> Positive, Negative
file_path = FilePath(panel_2)
test_remove_top_surfaces = BooleanToggle(False)
top_surfaces_to_remove_2 = BooleanToggle(True)
brep_5 = Brep(tree_branch_4)
remove_bottom_surfaces = GhPythonScript(
    Code=file_path,
    IsTop=top_surfaces_to_remove,
    IsTest=test_remove_bottom_surfaces,
    Surf=[tree_branch_2, split_tree_2.Positive])  # -> Out, List
remove_top_surfaces = GhPythonScript(
    Code=file_path,
    IsTop=top_surfaces_to_remove_2,
    IsTest=test_remove_top_surfaces,
    Surf=[split_tree.Positive, tree_branch_3, remove_bottom_surfaces.List])  # -> Out, List
panel_3 = Panel(remove_bottom_surfaces.List)
panel_4 = Panel(remove_top_surfaces.List)
trim_tree_3 = TrimTree(Tree=remove_top_surfaces.List, Depth=1)
cullnull_2 = CullNulls(item=[brep_5, trim_tree_3])
panel_5 = Panel(remove_bottom_surfaces.Out)
panel_6 = Panel(remove_top_surfaces.Out)
ghpython_script = GhPythonScript(x=cullnull_2)  # -> out, a; inputs x: tree
# ---------- ghpython_script: Python ----------
__author__ = "samu.karli"
__version__ = "2022.06.08"

import rhinoscriptsyntax as rs
from Grasshopper import DataTree as Tree
from Grasshopper.Kernel.Data import GH_Path as Path
from System import Array

a = Tree[object]()
iBranch = x.BranchCount
iPrev = -1

for i in range(iBranch):
    iCur = x.Path(i)[0]
    for j in range(iPrev + 1, iCur):
        obj = 0
        path = Path(Array[int]([j]))
        a.Add(obj, path)
        print path
    path = Path(Array[int]([iCur]))
    for k in x.Branch(i):
        a.Add(k, path)
    print path
    iPrev = iCur
# ---------- end ghpython_script ----------
panel_7 = Panel(trim_tree_3)
explode_tree = ExplodeTree(Data=ghpython_script.a)  # -> Branch0, Branch1, Branch2, Branch3, Branch4, Branch5
area_3 = Area(Geometry=cullnull_2)  # -> Area, Centroid
create_material = CreateMaterial(Diffuse=RGB(0, 80, 122), Specular=RGB(255, 255, 255), Emission=RGB(0, 0, 0), Transparency=0, Shine=0)
create_material_2 = CreateMaterial(Diffuse=RGB(240, 156, 31), Specular=RGB(255, 255, 255), Emission=RGB(0, 0, 0), Transparency=0, Shine=0)
create_material_3 = CreateMaterial(Diffuse=RGB(125, 24, 24), Specular=RGB(255, 255, 255), Emission=RGB(0, 0, 0), Transparency=0, Shine=0)
create_material_4 = CreateMaterial(Diffuse=RGB(169, 184, 61), Specular=RGB(255, 255, 255), Emission=RGB(0, 0, 0), Transparency=0, Shine=0)
create_material_5 = CreateMaterial(Diffuse=RGB(161, 61, 184), Specular=RGB(255, 255, 255), Emission=RGB(0, 0, 0), Transparency=0, Shine=0)
create_material_6 = CreateMaterial(Diffuse=RGB(161, 61, 184), Specular=RGB(255, 255, 255), Emission=RGB(0, 0, 0), Transparency=0, Shine=0)
mass_addition_3 = MassAddition(Input=area_3.Area)  # -> Result, PartialResults
unit_settings = GhPythonScript()  # -> out, a
# ---------- unit_settings: Python ----------
import rhinoscriptsyntax as rs
import Rhino


if Rhino.RhinoDoc.ActiveDoc.ModelUnitSystem.ToString() == "Meters":
    a = 1
elif Rhino.RhinoDoc.ActiveDoc.ModelUnitSystem.ToString() == "Centimeters":
    a = 100
else:
    a = 1000
# ---------- end unit_settings ----------
slab_2 = Panel("m2")
division = Division(A=[mass_addition_3.Result, path_mapper], B=unit_settings.a)
custom_preview = CustomPreview(Geometry=explode_tree.Branch1, Material=create_material_2)
custom_preview_2 = CustomPreview(Geometry=explode_tree.Branch2, Material=create_material_3)
custom_preview_3 = CustomPreview(Geometry=explode_tree.Branch3, Material=create_material_4)
custom_preview_4 = CustomPreview(Geometry=explode_tree.Branch4, Material=create_material_5)
custom_preview_5 = CustomPreview(Geometry=explode_tree.Branch0, Material=create_material)
custom_preview_6 = CustomPreview(Geometry=explode_tree.Branch5, Material=create_material_6)
concatenate_4 = Concatenate(FragmentA=division, FragmentB=slab_2, JoinSeparator=" ")
ghpython_script_2 = GhPythonScript(x=concatenate_4)  # -> out, a; inputs x: tree; same code as ghpython_script
explode_tree_2 = ExplodeTree(Data=ghpython_script_2.a)  # -> Branch0, Branch1, Branch2, Branch3, Branch4, Branch5

# ---- group: OUTPUT
column_2 = Panel(explode_tree_2.Branch3)
roof_2 = Panel(explode_tree_2.Branch4)
opening = Panel(explode_tree_2.Branch5)
slab_3 = Panel(explode_tree_2.Branch0)
wall_2 = Panel(explode_tree_2.Branch2)
beam_2 = Panel(explode_tree_2.Branch1)

# ==== cluster CullNulls: Culls null items from a list
item = ClusterInput()
null_item = NullItem(Item=item)  # -> NullFlags, InvalidFlags, Description
gate_not = GateNot(A=null_item.NullFlags)
cull_pattern = CullPattern(List=item, CullPattern=gate_not)
list = ClusterOutput(cull_pattern)

# ==== cluster CleanupBreps
value = ClusterInput()
extrusion_direction = ClusterInput()
brep = ClusterInput()
brep_edges = BrepEdges(Brep=brep)  # -> simplify(Naked), Interior, NonManifold
boundary_surfaces = BoundarySurfaces(Edges=brep_edges.Naked)
brep_join = BrepJoin(Breps=boundary_surfaces)  # -> Breps, Closed
brep_edges_2 = BrepEdges(Brep=brep_join.Breps)  # -> simplify(Naked), Interior, NonManifold
negative = Negative(Value=value)
boundary_surfaces_2 = BoundarySurfaces(Edges=brep_edges_2.Naked)
face_normals = FaceNormals(Mesh=boundary_surfaces_2)  # -> Centers, Normals
amplitude = Amplitude(Vector=face_normals.Normals, Amplitude=negative)
extrude = Extrude(Base=boundary_surfaces_2, Direction=[amplitude, extrusion_direction])
sort_duplicate_breps = SortDuplicateBreps(Breps=extrude)  # -> UniqueBreps, Indices
brep_2 = Brep(flatten(sort_duplicate_breps.UniqueBreps))
brep_3 = ClusterOutput(brep_2)

# ==== cluster Cluster
list = ClusterInput()
item = ClusterInput()
insert_items = InsertItems(List=list, Item=item, Indices=0, Wrap=True)
list_2 = ClusterOutput(insert_items)
