# Grasshopper definition Poroszsüveg generátor.ghx (Grasshopper 1.0.7)
# plug-ins: Grasshopper-ARCHICAD Live Connection built for Rhinoceros 7

panel = Panel("L:\03_szervezeti_egysegek\09_bim\11_Fejlesztesek\Poroszsüveg_generátor\IPECSV.csv")

boltozat_magasság = Slider(500, range=0..1000)
tégla_vastagság = Slider(120, range=0..500)
szinkron = BooleanToggle(False)

# ---- group: AC profil
profile = Profile()

# ----
file_path = FilePath(panel)

# ---- group: Gerendák
_2d_curve = _2DCurve([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])

# ---- group: Födém kontúr
_2d_curve_2 = _2DCurve(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)

# ----
ipe_beam = IPEBEAM(ipe_profile=profile, file_path=file_path)  # -> profil_2, t_talpmagasság_cm_2
curve = Curve(_2d_curve_2)
curve_2 = Curve(_2d_curve)
scale = Scale(Geometry=ipe_beam.profil_2, Center=Point(0, 0, 0), Factor=0.1)  # -> Geometry, Transform
number = Number(ipe_beam.t_talpmagasság_cm_2)

# ---- group: DWG profil
curve_3 = Curve(scale.Geometry)

# ---- group: Arcs
end_points = EndPoints(Curve=curve_2)  # -> Start, End
sort_points = SortPoints(Points=end_points.Start)  # -> Points, Indices
sort_points_2 = SortPoints(Points=end_points.End)  # -> Points, Indices
ghpython_script = GhPythonScript(x=sort_points.Points)  # -> a; inputs x: list
# ---------- ghpython_script: Python ----------
__author__ = "jozsef.szilagyi"
__version__ = "2021.06.02"

import rhinoscriptsyntax as rs

L_Points = x
I_ListLength = len(L_Points)
OutList = []
checkPoint = 0

while checkPoint < I_ListLength-1:
    Point1 = L_Points[checkPoint]
    Point2 = L_Points[checkPoint+1]
    OutList.append(Point1)
    OutList.append(Point2)
    checkPoint = checkPoint+1

a = OutList
# ---------- end ghpython_script ----------
ghpython_script_2 = GhPythonScript(x=sort_points_2.Points)  # -> a; inputs x: list; same code as ghpython_script
partition_list = PartitionList(List=ghpython_script_2, Size=2)
partition_list_2 = PartitionList(List=ghpython_script, Size=2)
list_item = ListItem(List=partition_list, Index=0, Wrap=True)  # -> Item, Item1
list_item_2 = ListItem(List=partition_list_2, Index=0, Wrap=True)  # -> Item, Item1
unit_z = UnitZ(Factor=boltozat_magasság)
tween_2p = Tween2P(point_a=list_item.Item, point_b=list_item.Item1, factor=0.5)
tween_2p_2 = Tween2P(point_a=list_item_2.Item, point_b=list_item_2.Item1, factor=0.5)
move = Move(Geometry=tween_2p_2, Motion=unit_z)  # -> Geometry, Transform
move_2 = Move(Geometry=tween_2p, Motion=unit_z)  # -> Geometry, Transform
arc_3pt = Arc3Pt(PointA=list_item.Item, PointB=move_2.Geometry, PointC=list_item.Item1)  # -> Arc, Plane, Radius
arc_3pt_2 = Arc3Pt(PointA=list_item_2.Item, PointB=move.Geometry, PointC=list_item_2.Item1)  # -> Arc, Plane, Radius
create_set = CreateSet(List=number)  # -> Set, Map
vector_2pt = Vector2Pt(PointA=list_item_2.Item, PointB=list_item_2.Item1, Unitize=True)  # -> Vector, Length
vector_2pt_2 = Vector2Pt(PointA=list_item.Item, PointB=list_item.Item1, Unitize=True)  # -> Vector, Length
division = Division(A=create_set.Set, B=2)
division_2 = Division(A=create_set.Set, B=2)
multiplication = Multiplication(A=vector_2pt_2.Vector, B=division_2)
multiplication_2 = Multiplication(A=vector_2pt.Vector, B=division)
multiplication_3 = Multiplication(A=boltozat_magasság, B=10)
unit_z_2 = UnitZ(Factor=multiplication_3)
move_3 = Move(Geometry=list_item_2.Item, Motion=multiplication_2)  # -> simplify(Geometry), Transform
move_4 = Move(Geometry=list_item.Item, Motion=multiplication)  # -> simplify(Geometry), Transform
move_5 = Move(Geometry=move_3.Geometry, Motion=unit_z_2)  # -> simplify(Geometry), Transform
move_6 = Move(Geometry=move_4.Geometry, Motion=unit_z_2)  # -> simplify(Geometry), Transform
line = Line(StartPoint=move_3.Geometry, EndPoint=move_5.Geometry)
line_2 = Line(StartPoint=move_4.Geometry, EndPoint=move_6.Geometry)
curve_curve = CurveCurve(CurveA=arc_3pt_2.Arc, CurveB=line)  # -> Points, ParamsA, ParamsB
curve_curve_2 = CurveCurve(CurveA=arc_3pt.Arc, CurveB=line_2, UseTasks=True)  # -> Points, ParamsA, ParamsB
vector_2pt_3 = Vector2Pt(PointA=curve_curve.Points, PointB=move_3.Geometry, Unitize=False)  # -> Vector, Length
vector_2pt_4 = Vector2Pt(PointA=curve_curve_2.Points, PointB=move_4.Geometry, Unitize=False)  # -> Vector, Length
move_7 = Move(Geometry=arc_3pt.Arc, Motion=vector_2pt_4.Vector)  # -> Geometry, Transform
move_8 = Move(Geometry=arc_3pt_2.Arc, Motion=vector_2pt_3.Vector)  # -> Geometry, Transform
unit_z_3 = UnitZ(Factor=number)
move_9 = Move(Geometry=move_7.Geometry, Motion=unit_z_3)  # -> Geometry, Transform
move_10 = Move(Geometry=move_8.Geometry, Motion=unit_z_3)  # -> Geometry, Transform
unit_z_4 = UnitZ(Factor=tégla_vastagság)
loft = Loft(
    Curves=[move_10.Geometry, move_9.Geometry],
    Options={Adjust=False, Closed=False, LoftEnds=0, LoftSimp=0, LoftType=0, Rebuild=10, Refit=0.01})
extrude = Extrude(Base=loft, Direction=unit_z_4)

# ----
curve_4 = Curve(curve_2)
move_11 = Move(Geometry=curve_3, Motion=sort_points.Points)  # -> Geometry, Transform
unit_z_5 = UnitZ(Factor=5000)
extend_curve = ExtendCurve(Curve=curve_4, Type=0, Start=100, End=100)
extrude_2 = Extrude(Base=extend_curve, Direction=unit_z_5)
surface = Surface(curve)
solid_difference = SolidDifference(BrepsA=simplify(flatten(extrude)), BrepsB=simplify(flatten(extrude_2)))
extrude_along = ExtrudeAlong(Base=move_11.Geometry, Curve=extend_curve)
area = Area(Geometry=surface)  # -> Area, Centroid
extrude_3 = Extrude(Base=surface, Direction=unit_z_5)
unit_z_6 = UnitZ(Factor=-100)
cap_holes = CapHoles(Brep=extrude_along)
move_12 = Move(Geometry=extrude_3, Motion=unit_z_6)  # -> Geometry, Transform
brep = Brep(solid_difference)
solid_intersection = SolidIntersection(BrepsA=brep, BrepsB=move_12.Geometry)
scale_2 = Scale(Geometry=surface, Center=area.Centroid, Factor=10)  # -> Geometry, Transform
unit_z_7 = UnitZ(Factor=-3000)
extrude_4 = Extrude(Base=scale_2.Geometry, Direction=unit_z_7)
solid_difference_2 = SolidDifference(BrepsA=solid_intersection, BrepsB=extrude_4)
solid_difference_3 = SolidDifference(BrepsA=solid_difference_2, BrepsB=cap_holes)

# ---- group: OUTPUT
morph_settings = MorphSettings(BuildingMaterial=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, Layer=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)
morph_solid = MorphSolid(Synchronize=szinkron, Mesh=solid_difference_3, MorphSettings=morph_settings)

# ==== cluster Tween2P
point_a = ClusterInput()
point_b = ClusterInput()
factor = ClusterInput()
point_a_2 = Point(point_a)
point_b_2 = Point(point_b)
factor_2 = Number(factor)
vector_2pt = Vector2Pt(PointA=point_a_2, PointB=point_b_2, Unitize=False)  # -> Vector, Length
multiplication = Multiplication(A=vector_2pt.Vector, B=factor_2)
move = Move(Geometry=point_a_2, Motion=multiplication)  # -> Geometry, Transform
tween = Point(move.Geometry)
tween_2 = ClusterOutput(tween)

# ==== cluster IPEBEAM
file_path = ClusterInput()
file_path_2 = FilePath(file_path)
read_file = ReadFile(File=file_path_2, PerLineParse=True)
split_list = SplitList(List=read_file, Index=1)  # -> ListA, ListB
text_split = TextSplit(Text=split_list.ListB, Separators=",")
ipe_profile = ClusterInput()
ipe_profile_2 = Text(ipe_profile)
list_item = ListItem(List=text_split, Index=1, Wrap=True)  # -> flatten(Item)
panel = Panel(text_split)
b = ListItem(List=text_split, Index=3, Wrap=True)  # -> flatten(Item)
s = ListItem(List=text_split, Index=4, Wrap=True)  # -> flatten(Item)
t = ListItem(List=text_split, Index=5, Wrap=True)  # -> flatten(Item)
h = ListItem(List=text_split, Index=2, Wrap=True)  # -> flatten(Item)
member_index = MemberIndex(Set=list_item, Member=ipe_profile_2)  # -> Index, Count
list_item_2 = ListItem(List=h, Index=member_index.Index, Wrap=True)  # -> flatten(Item)
list_item_3 = ListItem(List=s, Index=member_index.Index, Wrap=True)  # -> flatten(Item)
list_item_4 = ListItem(List=t, Index=member_index.Index, Wrap=True)  # -> flatten(Item)
list_item_5 = ListItem(List=b, Index=member_index.Index, Wrap=True)  # -> flatten(Item)
division = Division(A=list_item_5, B=2)
division_2 = Division(A=list_item_3, B=2)
division_3 = Division(A=list_item_4, B=10)
addition = Addition(A=division, B=division_2)
subtraction = Subtraction(A=division, B=division_2)
subtraction_2 = Subtraction(A=list_item_2, B=list_item_4)
construct_point = ConstructPoint(XCoordinate=0, YCoordinate=0, ZCoordinate=0)
construct_point_2 = ConstructPoint(XCoordinate=list_item_5, YCoordinate=0, ZCoordinate=0)
construct_point_3 = ConstructPoint(XCoordinate=list_item_5, YCoordinate=0, ZCoordinate=list_item_4)
construct_point_4 = ConstructPoint(XCoordinate=addition, YCoordinate=0, ZCoordinate=list_item_4)
construct_point_5 = ConstructPoint(XCoordinate=list_item_5, YCoordinate=0, ZCoordinate=subtraction_2)
construct_point_6 = ConstructPoint(XCoordinate=addition, YCoordinate=0, ZCoordinate=subtraction_2)
construct_point_7 = ConstructPoint(XCoordinate=list_item_5, YCoordinate=0, ZCoordinate=list_item_2)
construct_point_8 = ConstructPoint(XCoordinate=0, YCoordinate=0, ZCoordinate=list_item_2)
construct_point_9 = ConstructPoint(XCoordinate=0, YCoordinate=0, ZCoordinate=subtraction_2)
construct_point_10 = ConstructPoint(XCoordinate=subtraction, YCoordinate=0, ZCoordinate=subtraction_2)
construct_point_11 = ConstructPoint(XCoordinate=subtraction, YCoordinate=0, ZCoordinate=list_item_4)
construct_point_12 = ConstructPoint(XCoordinate=0, YCoordinate=0, ZCoordinate=list_item_4)
construct_point_13 = ConstructPoint(XCoordinate=0, YCoordinate=0, ZCoordinate=0)
negative = Negative(Value=division)
polyline = PolyLine(
    Vertices=[construct_point, construct_point_2, construct_point_3, construct_point_4, construct_point_6, construct_point_5, construct_point_7, construct_point_8, construct_point_9, construct_point_10, construct_point_11, construct_point_12, construct_point_13],
    Closed=False)
unit_x = UnitX(Factor=negative)
move = Move(Geometry=polyline, Motion=unit_x)  # -> Geometry, Transform
t_talpmagasság_cm = Number(division_3)
profil = Curve(move.Geometry)
profil_2 = ClusterOutput(profil)
t_talpmagasság_cm_2 = ClusterOutput(t_talpmagasság_cm)
